# Grasshopper definition 0. Urban Generation.gh (Grasshopper 1.0.8)
# plug-ins: RhinoCodePluginGH, Telepathy

# Генерация сетки кварталов по указнным габаритам и смещениям
number_slider = Slider(50000, range=0..100000)
number_slider_2 = Slider(70, range=0..200)
dom = ConstructDomain(DomainStart=number_slider, DomainEnd=Slider(100000, range=0..1000000))
range = Range(Domain=dom, Steps=number_slider_2)
py3 = Python3Script(n=number_slider_2)  # -> out, icons; inputs n: Int32
# ---------- py3: Python ----------
n+=1

import numpy as np
import random
import ghpythonlib.treehelpers as th

random.seed(42)

def generate_puzzle_grid(n):
    grid = np.full((n, n), -1)  # Инициализируем сетку значением -1 (неразмеченная)
    piece_id = 0  # Начальный номер детали
    
    # Создаём список всех координат
    available_cells = set((i, j) for i in range(n) for j in range(n))
    
    while available_cells:
        # Выбираем первую доступную клетку
        start_cell = next(iter(available_cells))
        queue = [start_cell]
        piece_size = random.randint(1, 4)  # Ограничиваем размер детали максимум 3
        
        cells = []
        while queue and len(cells) < piece_size:
            cell = queue.pop(0)
            if cell in available_cells:
                available_cells.remove(cell)
                cells.append(cell)
                
                # Добавляем соседей случайным образом
                i, j = cell
                neighbors = [(i-1, j), (i+1, j), (i, j-1), (i, j+1)]
                random.shuffle(neighbors)
                for ni, nj in neighbors:
                    if (ni, nj) in available_cells:
                        queue.append((ni, nj))
        
        # Заполняем найденные клетки одним номером
        for i, j in cells:
            grid[i, j] = piece_id
        piece_id += 1
    
    return grid

puzzle_grid = generate_puzzle_grid(n)
puzzle_lent = puzzle_grid.flatten()
icons = []
for d in range(puzzle_lent.min(), puzzle_lent.max()+1):
    detail = []
    for i in range(len(puzzle_lent)):
        if puzzle_lent[i] == d:
            detail.append(i)
    icons.append(detail)
icons = th.list_to_tree(icons)
# ---------- end py3 ----------
addition = Addition(A=range, B=Slider(6000, range=0..10000))
jitter = Jitter(List=addition, Jitter=1, Seed=2)  # -> Values, Indices
jitter_2 = Jitter(List=addition, Jitter=1, Seed=Slider(3, range=0..10))  # -> Values, Indices
ma = MassAddition(Input=jitter.Values)  # -> Result, PartialResults
ma_2 = MassAddition(Input=jitter_2.Values)  # -> Result, PartialResults
merge = Merge(Data1=flatten("0"), Data2=flatten(ma.PartialResults))
merge_2 = Merge(Data1=flatten("0"), Data2=flatten(ma_2.PartialResults))
pt = ConstructPoint(XCoordinate=merge, YCoordinate=0, ZCoordinate=0)
# Получение полигонов домов из сгенерированной мэш-сетки
number_slider_3 = Slider(400, range=0..1000)
Y = UnitY(Factor=merge_2)
pline = PolyLine(Vertices=pt, Closed=False)
move = Move(Geometry=pline, Motion=Y)  # -> Geometry, Transform
explode = Explode(Curve=move.Geometry, Recursive=True)  # -> Segments, Vertices
pt_2 = ConstructPoint(XCoordinate=0, YCoordinate=0, ZCoordinate=number_slider_3)
mesh = Mesh(<mesh referenced from the Rhino model>)
flip = FlipMatrix(Data=explode.Segments)
xy = XYPlane(Origin=pt_2)
sec = MeshPlane(Mesh=mesh, Plane=xy)
neg = Negative(Value=number_slider_3)
ipy2 = IronPython2Script(x=flip)  # -> out, a, b; inputs x: list
# ---------- ipy2: IronPython ----------
a = x[:-1]
b = x[1:]
# ---------- end ipy2 ----------
simplify = SimplifyCurve(Curve=sec)  # -> Curve, Simplified
Z = UnitZ(Factor=neg)
merge_3 = Merge(Data1=graft(ipy2.a), Data2=graft(ipy2.b))
move_2 = Move(Geometry=simplify.Curve, Motion=Z)  # -> Geometry, Transform
loft = Loft(Curves=merge_3, Options={Adjust=False, Closed=False, LoftEnds=0, LoftSimp=0, LoftType=0, Rebuild=10, Refit=0.01})  # -> flatten(Loft)
boundary = BoundarySurfaces(Edges=move_2.Geometry)
item = ListItem(List=loft, Index=py3.icons, Wrap=True)
join = BrepJoin(Breps=boundary)  # -> Breps, Closed
join_2 = BrepJoin(Breps=item)  # -> Breps, Closed
edges = BrepEdges(Brep=join.Breps)  # -> Naked, Interior, NonManifold
edges_2 = BrepEdges(Brep=join_2.Breps)  # -> Naked, Interior, NonManifold
crv = Curve(edges.Naked)
crv_2 = Curve(edges_2.Naked)
join_3 = JoinCurves(Curves=crv, Preserve=False)
join_4 = JoinCurves(Curves=crv_2, Preserve=False)
simplify_2 = SimplifyCurve(Curve=join_3)  # -> flatten(Curve), Simplified
simplify_3 = SimplifyCurve(Curve=join_4)  # -> Curve, Simplified
houses = RemoteSender(simplify_2.Curve)
quarters = RemoteSender(simplify_3.Curve)
houses_2 = RemoteReceiver(houses)
quarters_2 = RemoteReceiver(quarters)
panel = Panel("Запись итоговых кварталов")
area = Area(Geometry=houses_2)  # -> Area, flatten(Centroid)
incurve = PointInCurve(Point=area.Centroid, Curve=quarters_2)  # -> Relationship, Point
cull = CullPattern(List=houses_2, CullPattern=incurve.Relationship)
trim = TrimTree(Tree=cull, Depth=Slider(2, range=0..10))
trim_2 = TrimTree(Tree=quarters_2, Depth=Slider(2, range=0..10))
ipy2_2 = IronPython2Script(out_curves=trim_2, in_curves=trim, path="C:/city2.json")  # -> out, a; inputs out_curves: tree of Curve, in_curves: tree of Curve, path: String; disabled
# ---------- ipy2_2: IronPython ----------
import rhinoscriptsyntax as rs
import ghpythonlib.components as gh
import ghpythonlib.treehelpers as th
import Rhino.Geometry as rg
import json

def rgp2c(polyline_curve):
    if not polyline_curve.IsClosed:
        raise ValueError("Polyline должна быть замкнутой!")
    polyline = polyline_curve.ToPolyline()
    coords = [(pt.X, pt.Y) for pt in polyline]
    return coords

out_curves = th.tree_to_list(out_curves)
in_curves = th.tree_to_list(in_curves)

result = {'out': [], 'ins': []}
for out_cs, in_cs in zip(out_curves, in_curves):
    out_crv = rgp2c(out_cs[0])
    in_crvs = [rgp2c(i) for i in in_cs]
    result['out'].append(out_crv)
    result['ins'].append(in_crvs)

with open(path, "w") as f:
    json.dump(result, f, indent=4, ensure_ascii=False)
# ---------- end ipy2_2 ----------
